# Grasshopper definition robot.ghx (Grasshopper 0.9.76)
# plug-ins: Python Interpreter

reload = Button()

# ---- group: ROS client
disconnect = Button()
connect = Button()
restart = Button()
ros = PythonScript(restart=restart)  # -> out, ros_client
# ---------- ros: Python ----------
import sys
import time
import logging
import scriptcontext as sc

from compas_fab.backends import RosClient

from System import TimeSpan
from System.Threading import ManualResetEventSlim

LOGGER = logging.getLogger('roslibpy')

key = 'rosclient_%s' % str(ghenv.Component.InstanceGuid)
previous_client = sc.sticky.get(key, None)
if previous_client:
    previous_client.terminate()

ros_client = RosClient('127.0.0.1', 9090)
sc.sticky[key] = ros_client

waitLock = ManualResetEventSlim(False)

ros_client.on_ready(lambda: waitLock.Set())

if not waitLock.Wait(TimeSpan.FromSeconds(5)):
    raise Exception('Unable to connect to ROS')

LOGGER.info('ROS connection opened')
# ---------- end ros ----------
connect_2 = PythonScript(ros_client=ros.ros_client, connect=connect, disconnect=disconnect)  # -> out, ros_client
# ---------- connect_2: Python ----------
import logging
from System import TimeSpan
from System.Threading import ManualResetEventSlim

LOGGER = logging.getLogger('roslibpy')

if connect:
    if not ros_client.is_connected:
        LOGGER.debug('Connecting...')
        waitLock = ManualResetEventSlim(False)
        ros_client.on_ready(lambda: waitLock.Set())
        ros_client.connect()

        if not waitLock.Wait(TimeSpan.FromSeconds(5)):
            raise Exception('Unable to connect to ROS')
        LOGGER.debug('Reconnected')

if disconnect:
    if ros_client.is_connected:
        ros_client.terminate()
        LOGGER.debug('Terminated')
# ---------- end connect_2 ----------

# ----
py = PythonScript(reload=reload)
# ---------- py: Python ----------
from compas_rhino.utilities.misc import get_tolerance
from compas_rhino.utilities.misc import unload_modules

from compas_ghpython import unload_modules
unload_modules("compas")
unload_modules("compas_fab")
unload_modules("roslibpy")
# ---------- end py ----------
units = ValueList({"m": 1, "cm": 100, "mm": 1000}, selected="mm")

# ----
# Robot
panel = Panel("C:\Users\rustr\workspace\robot_description\")
list = ValueList({"ur5", "ur10", "abb_irb6640_185_280", "staubli_tx60l", "panda", "ur5_with_measurement_tool"}, selected="staubli_tx60l")
path = PythonScript(path=panel, robot_name=list)  # -> resource_path
# ---------- path: Python ----------
import os

resource_path = os.path.join(os.path.abspath(path), robot_name)

assert(os.path.isdir(resource_path))
# ---------- end path ----------
load = Button()
create = PythonScript(resource_path=path, scale_factor=units, load=load)  # -> out, robot
# ---------- create: Python ----------
from scriptcontext import sticky as st

import compas
import compas.robots

from compas_fab.robots import Robot
from compas_fab.robots.semantics import RobotSemantics
from compas_fab.robots.ros_fileserver_loader import RosFileServerLoader

from compas_fab.ghpython import RobotArtist

# Robot meshes are usually in meters
# Set a high percision to prevent parsing errors
# and configure Rhino itself in meters
compas.PRECISION = '12f'

# store data in component
guid = str(ghenv.Component.InstanceGuid)
robot_key = "robot_" + guid

if robot_key not in st:
    st[robot_key] = None
    
if load:
    loader = RosFileServerLoader.from_robot_resource_path(resource_path)
    
    model = compas.robots.Robot.from_urdf_file(loader.urdf_filename)
    model.load_geometry(loader)
    artist = RobotArtist(model)
    
    semantics = RobotSemantics.from_srdf_file(loader.srdf_filename, model)
    
    robot = Robot(model, artist, semantics, client=None)

    st[robot_key] = robot

robot = st[robot_key]

if robot:
    robot.scale(scale_factor)
# ---------- end create ----------
set = PythonScript(robot=create.robot, client=connect_2.ros_client)
# ---------- set: Python ----------
if robot and client:
    robot.client = client
# ---------- end set ----------
robot = Data(create.robot)

# ----
# Info
info = PythonScript(robot=robot)  # -> out, planning_groups, main_group, base_frame, all_joint_names, main_joint_names
# ---------- info: Python ----------
from compas.robots import Joint

if robot:
    planning_groups = robot.group_names
    main_group = robot.main_group_name
    all_joint_names = robot.get_configurable_joint_names()
    main_joint_names = robot.get_configurable_joint_names(main_group)
    base_frame = robot.get_base_frame()
    
    print "planning groups:", planning_groups
    print "main planning group:", main_group
    print "base_frame:", base_frame
    
    print "Joints of main planning group:"
    for joint in robot.get_configurable_joints(main_group):
        info = "    %s is of type '%s'" % (joint.name, list(Joint.SUPPORTED_TYPES)[joint.type])
        if joint.limit:
            info += " and has limits [%.3f, %.3f]" % (joint.limit.upper, joint.limit.lower)
        print info
# ---------- end info ----------
panel_2 = Panel(info.out)

list_2 = ValueList({"+1": 1, "-1"}, selected="-1")
X = UnitX(Factor=list_2)
pt = Point(Point(296.4261221, -361.5870916, 430.1247299))
py_2 = PythonScript(pt=pt, zaxis=X)  # -> plane; inputs pt: Point3d, zaxis: Vector3d
# ---------- py_2: Python ----------
import Rhino.Geometry as rg

plane = rg.Plane(pt, zaxis)
# ---------- end py_2 ----------

# ----
# Configuration
main_planning_group = Text(info.main_group)

# ---- group: forward kinematics
a1 = Slider(0, range=-360..360)
a6 = Slider(0, range=-360..360)
a4 = Slider(0, range=-360..360)
a5 = Slider(0, range=-360..360)
a2 = Slider(0, range=-360..360)
a3 = Slider(0, range=-360..360)
forward_kinematics = PythonScript(robot=robot, a1=a1, a2=a2, a3=a3, a4=a4, a5=a5, a6=a6)  # -> configuration
# ---------- forward_kinematics: Python ----------
import math
from compas_fab.robots import Configuration

if robot:
    joint_positions = [a1, a2, a3, a4, a5, a6]
    joint_positions = [math.radians(a) for a in joint_positions ]
    configuration = Configuration.from_revolute_values(joint_positions)
# ---------- end forward_kinematics ----------

# ---- group: inverse kinematics
pt_2 = Point(Point(343.5236112, 95.78491454, 683.7731277))
xy = XYPlane(Origin=pt_2)
ik = PythonScript(robot=robot, group=main_planning_group, plane=xy)  # -> configuration, error
# ---------- ik: Python ----------
import scriptcontext as sc
import logging

from compas.geometry import Frame

from compas_fab.backends.ros import MoveItErrorCodes
from compas_fab.robots import Configuration


LOGGER = logging.getLogger('roslibpy')

guid = str(ghenv.Component.InstanceGuid)
response_key = "response_" + guid

if response_key not in sc.sticky:
    sc.sticky[response_key] = None
    

def callback_result(response):
    sc.sticky[response_key] = response
    
if robot:
    if robot.client:
        if robot.client.is_connected:
            frame = Frame(plane.Origin, plane.XAxis, plane.YAxis)
            current_configuration = robot.get_configuration(group)
            robot.inverse_kinematics(frame, current_configuration, callback_result, group)

if sc.sticky[response_key]:
    response = sc.sticky[response_key]
    if response.error_code == MoveItErrorCodes.SUCCESS:
        joint_positions = response.solution.joint_state.position
        configuration = robot.get_configuration()
        configuration.values = joint_positions
    error = response.error_code.human_readable
# ---------- end ik ----------
error = Panel(ik.error)

# ---- group: calculate path
max_step_mm = Slider(10, range=1..500)
start_configuration = Data(ik.configuration)
py_3 = PythonScript(start_plane=xy, end_plane=py_2)  # -> planes
# ---------- py_3: Python ----------
planes = [start_plane, end_plane]
print planes
# ---------- end py_3 ----------
avoid_collisions = BooleanToggle(True)
compute = Button()
compute_path = PythonScript(
    robot=robot,
    group=main_planning_group,
    start_configuration=start_configuration,
    planes=py_3,
    max_step=max_step_mm,
    avoid_collisions=avoid_collisions,
    compute=compute)  # -> response; inputs planes: list, avoid_collisions: Boolean
# ---------- compute_path: Python ----------
import logging
import scriptcontext as sc

from compas.geometry import Frame

from compas_ghpython.utilities import update_component

guid = str(ghenv.Component.InstanceGuid)
response_key = "response_" + guid
if response_key not in sc.sticky:
    sc.sticky[response_key] = None
    
LOGGER = logging.getLogger('roslibpy')
data = dict(requesting_solution=False)

def callback_result(response):
    sc.sticky[response_key] = response
    update_component(ghenv, 100)

if robot:
    if robot.client:
        if robot.client.is_connected and start_configuration and compute:
    
            frames = [Frame(plane.Origin, plane.XAxis, plane.YAxis) for plane in planes]
            robot.compute_cartesian_path(frames, start_configuration, float(max_step),
                                         bool(avoid_collisions), callback_result, group)

response = sc.sticky[response_key]
# ---------- end compute_path ----------
py_4 = PythonScript(response=compute_path)  # -> joint_positions, error, fraction
# ---------- py_4: Python ----------
from compas_fab.backends.ros import MoveItErrorCodes

joint_positions = []

if response:
    if response.error_code == MoveItErrorCodes.SUCCESS:
        start_position = response.start_state.joint_state.position
        for point in response.solution.joint_trajectory.points:
            joint_positions.append(point.positions)
    error = response.error_code.human_readable
    fraction = response.fraction
# ---------- end py_4 ----------
fraction = Panel(py_4.fraction)
error_2 = Panel(py_4.error)
animate = PythonScript(robot=robot, joint_positions=py_4.joint_positions, value=Slider(0, range=0..1))  # -> configuration; inputs joint_positions: list
# ---------- animate: Python ----------
from compas_fab.utilities import map_range
from compas_fab.robots import Configuration

count = len(joint_positions)
if count and robot:
    idx = int(map_range(value, 0, 1, 0, count - 1))
    joint_position = joint_positions[idx]
    configuration = Configuration.from_revolute_values(joint_position)
elif robot:
    configuration = robot.init_configuration()
# ---------- end animate ----------

# ----
# Visualisation
# Select configuration input: from fk, ik, path, or from real robot
list_3 = ValueList({"0 forward_kinematics": 0, "1 inverse_kinematics": 1, "2 calculated_path": 2}, selected="0 forward_kinematics")
filter = StreamFilter(Gate=list_3, Stream0=forward_kinematics, Stream1=ik.configuration, Stream2=animate)
show_end_effector_frame = BooleanToggle(True)
show_base_frame = BooleanToggle(False)
show_collision = BooleanToggle(False)
show_visual = BooleanToggle(True)
show_axes = BooleanToggle(True)
visualize = PythonScript(
    robot=robot,
    configuration=filter,
    show_visual=show_visual,
    show_collision=show_collision,
    show_axes=show_axes,
    show_base_frame=show_base_frame,
    show_end_effector_frame=show_end_effector_frame)  # -> out, visual, collision, axes, axes_color, ee_plane, ee_frame, ee_frame_geo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
# ---------- visualize: Python ----------
from System.Drawing import Color

from compas.geometry import Vector
from compas.geometry import Point
from compas_ghpython.utilities import xdraw_frame
from compas_ghpython.utilities import xdraw_pipes

from compas_fab.robots import Configuration

red = Color.FromArgb(255, 0, 0)
green = Color.FromArgb(0, 255, 0)
blue = Color.FromArgb(0, 0, 255)

frame_colors = [red, green, blue]

# TODO: move to frame artist?
def pipes_from_frame(frame, size, radius): 
    pipes = []
    for axis in [frame.xaxis, frame.yaxis, frame.zaxis]:
        pipe = {}
        pipe['points'] = [list(frame.point), list(Point(*frame.point) + Vector(*axis) * size)]
        pipe['radius'] = radius
        pipes.append(pipe)
    return pipes

if robot and configuration:
    
    pipe_size = 0.1 * robot.scale_factor
    pipe_radius = 0.001 * robot.scale_factor
    
    robot.update(configuration, collision=show_collision)
    
    print("Configuration:")
    print(configuration.values)
    
    if show_visual:
        visual = robot.draw_visual()
        
    if show_collision:
        collision = robot.draw_collision()
    
    if show_axes:
        pipes = []
        axes_color = []
        for frame in robot.frames:
            pipes += pipes_from_frame(frame, pipe_size, pipe_radius)
            axes_color += frame_colors
        axes = xdraw_pipes(pipes, cap=1)
    
    ee_frame = robot.get_end_effector_frame()
    ee_plane = xdraw_frame(ee_frame)
    
    print("End-effector frame:")
    print(ee_frame)
    
    if show_end_effector_frame:
        ee_pipes = pipes_from_frame(ee_frame, pipe_size, pipe_radius)
        ee_frame_geo = xdraw_pipes(ee_pipes, cap=1)
        ee_frame_color = frame_colors
        
    base_frame = robot.get_base_frame()
    base_plane = xdraw_frame(base_frame)
    
    if show_base_frame:
        base_pipes = pipes_from_frame(base_frame, pipe_size, pipe_radius)
        base_frame_geo = xdraw_pipes(base_pipes, cap=1)
        base_frame_color = frame_colors
# ---------- end visualize ----------
preview = CustomPreview(Geometry=visualize.axes, Shader=visualize.axes_color)
preview_2 = CustomPreview(Geometry=visualize.ee_frame_geo, Shader=visualize.ee_frame_color)
preview_3 = CustomPreview(Geometry=visualize.base_frame_geo, Shader=visualize.base_frame_color)
geo = Geometry(visualize.visual)
geo_2 = Geometry(visualize.collision)
panel_3 = Panel(visualize.out)
