# Grasshopper definition model.gh (Grasshopper 0.9.76)
# plug-ins: Python Interpreter

# angleB
# speed
# data for further calculation
# set path
# set path
# set path
# set path
# set path
# set path
# set path
# force
# force
# force
# force
# force
# force
# angleA
# angleA
# angleA
# angleA
# angleA
# angleA
# angleB
# angleB
# angleB
# angleB
# angleB
# angleB
# speed
# speed
# speed
# speed
# speed
# speed
# force
# force
# force
# force
# force
# force
# angleA
# angleA
# angleA
# angleA
# angleA
# angleA
# angleA
# angleA
# angleA
# angleA
# angleA
# angleA
# angleA
# angleB
# angleB
# angleB
# angleB
# angleB
# angleB
# speed
# speed
# speed
# speed
# speed
# speed
# speed
# speed
# speed
# speed
# speed
# speed
# speed
# data for further calculation
# data for further calculation
# data for further calculation
# data for further calculation
# data for further calculation
# data for further calculation
# material resistance
# force
# angleA
# angleB
# speed
# force
# angleA
# angleB
# speed
bang = Button()

# ---- group: meshes
# material resistance
# angleA
# material resistance
# angleB
# force
# speed
# angleA
base_shoulder = Mesh(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)
upperarm = Mesh(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)
forearm = Mesh(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)
wrist1 = Mesh(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)
wrist3 = Mesh(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)
wrist2 = Mesh(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)

# ---- group: breps
# angleB
# force
# speed
# angleA
# angleB
# force
# speed
# angleA
# angleB
# speed
# material resistance
# material resistance
# force
# force
# angleA
# angleA
# angleB
# angleB
# speed
# speed
# force
# force
# angleA
# angleA
# angleB
# speed
base_shoulder_2 = Brep(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)
upperarm_2 = Brep(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)
forearm_2 = Brep(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)
wrist1_2 = Brep(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)
wrist2_2 = Brep(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)
# Calculate spring extension
# material resistance
# force
# angleA
# angleB
# speed
# force
# angleA
# angleB
# speed
# material resistance
# force
# angleA
# angleB
# speed
# force
# angleA
# angleB
# angleB
# speed
# speed
wrist3_2 = Brep(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)

# ----
unload = PythonScript(bang=bang)
# ---------- unload: Python ----------
from compas_fabrication.fabrication.utilities.utilities import unload_module

unload_module("compas")
# ---------- end unload ----------

# ----
# 0
# angles, forward kinematic
elbow = Slider(0, range=-360..360)
wrist2_3 = Slider(0, range=-360..360)
base = Slider(0, range=-360..360)
shoulder = Slider(0, range=-360..360)
wrist1_3 = Slider(0, range=-360..360)
wrist3_3 = Slider(0, range=-360..360)
ur1_a1_a6 = Data([base, shoulder, elbow, wrist1_3, wrist2_3, wrist3_3])
rad = Radians(Degrees=ur1_a1_a6)

ur10_geo = Geometry([base_shoulder_2, upperarm_2, forearm_2, wrist1_2, wrist2_2, wrist3_2])
ur10_geo_mesh = Mesh([base_shoulder, upperarm, forearm, wrist1, wrist2, wrist3])

# ----
# 0
# angles, forward kinematic
elbow_2 = Slider(110.931, range=-360..360)
wrist2_4 = Slider(51.012, range=-360..360)
base_2 = Slider(-70.23, range=-360..360)
shoulder_2 = Slider(110, range=-360..360)
wrist1_4 = Slider(-100.64, range=-360..360)
wrist3_4 = Slider(-42.13, range=-360..360)
ur1_a1_a6_2 = Data([base_2, shoulder_2, elbow_2, wrist1_4, wrist2_4, wrist3_4])
rad_2 = Radians(Degrees=ur1_a1_a6_2)

# ----
# UR5
# Ex 1
use_brep = BooleanToggle(False)
ur5 = UR5(use_brep=use_brep)  # -> ur5_axes_2, ur5_geo_2, ur5_tp_2, ur5_workspace_2
set_robot = PythonScript(joint_axes=ur5.ur5_axes_2, link_geo=ur5.ur5_geo_2, tcp_plane=ur5.ur5_tp_2, workspace_geo=ur5.ur5_workspace_2)  # -> ur5; inputs joint_axes: list, link_geo: list
# ---------- set_robot: Python ----------
#import sys
#sys.path.append(r"C:\Users\kathrind\polybox\MAS")

from mas_lib.useful import import_or_reload

import_or_reload("mas_lib.robots", "Robot")
from mas_lib.robots import Robot

ur5 = Robot(link_geo, joint_axes, tcp_plane, workspace_geo)
# ---------- end set_robot ----------

python = PythonScript(x=Button())  # -> ur10, tool0
# ---------- python: Python ----------
from compas_fabrication.fabrication.robots.ur.ur10 import UR10
import Rhino.Geometry as rg

ur10 = UR10()



tool0 = rg.Plane(rg.Point3d(ur10.a2 + ur10.a3, -ur10.d4-ur10.d6, ur10.d1-ur10.d5), rg.Vector3d.XAxis, rg.Vector3d.ZAxis)
# ---------- end python ----------
python_2 = PythonScript(ur10=python.ur10, M=ur10_geo_mesh)  # -> ur10, M; inputs q: list, M: list
# ---------- python_2: Python ----------
from compas_fabrication.fabrication.grasshopper.mesh import draw_mesh
import Rhino.Geometry as rg

R0, R1, R2, R3, R4, R5 = ur10.get_forward_transformations(q)

print R0

def rhino_transform(transformation_matrix):
    T = rg.Transform(1)
    for x in range(4):
        for y in range(4):
            exec("T.M%i%i = transformation_matrix[%i][%i]" % (x,y,x,y))
    return T
robot_color = (180,180,180)

R0 = rhino_transform(R0.matrix)
R1 = rhino_transform(R1.matrix)
R2 = rhino_transform(R2.matrix)
R3 = rhino_transform(R3.matrix)
R4 = rhino_transform(R4.matrix)
R5 = rhino_transform(R5.matrix)

m0, m1, m2, m3, m4, m5 = M

m0.Transform(R0)
m1.Transform(R1)
m2.Transform(R2)
m3.Transform(R3)
m4.Transform(R4)
m5.Transform(R5)

#M = [m0, m1, m2, m3, m4, m5]

"""
M = []
M.append(draw_mesh(m0, vertexcolor = robot_color))
M.append(draw_mesh(m1, vertexcolor = robot_color))
M.append(draw_mesh(m2, vertexcolor = robot_color))
M.append(draw_mesh(m3, vertexcolor = robot_color))
M.append(draw_mesh(m4, vertexcolor = robot_color))
M.append(draw_mesh(m5, vertexcolor = robot_color))
"""
# ---------- end python_2 ----------
panel = Panel(rad_2)
num = Number(rad_2)
pln = Plane(python.tool0)
python_3 = PythonScript(q=num, ur10=python.ur10)  # -> ur10, M, pl; inputs q: list
# ---------- python_3: Python ----------
from compas_fabrication.fabrication.grasshopper.mesh import draw_mesh
import Rhino.Geometry as rg
from compas.geometry.elements import Point, Vector

m0, m1, m2, m3, m4, m5, tool0_frame, tool_frame = ur10.get_transformed_model(q)

R0, R1, R2, R3, R4, R5 = ur10.get_forward_transformations(q)

xaxis = Vector([1, 0, 0])
print R5 * xaxis


M = []
M.append(draw_mesh(m0, vertexcolor = robot_color))
M.append(draw_mesh(m1, vertexcolor = robot_color))
M.append(draw_mesh(m2, vertexcolor = robot_color))
M.append(draw_mesh(m3, vertexcolor = robot_color))
M.append(draw_mesh(m4, vertexcolor = robot_color))
M.append(draw_mesh(m5, vertexcolor = robot_color))

print tool0_frame

pl = rg.Plane(rg.Point3d(tool0_frame.point.x, tool0_frame.point.y, tool0_frame.point.z), rg.Vector3d(tool0_frame.xaxis.x, tool0_frame.xaxis.y, tool0_frame.xaxis.z), rg.Vector3d(tool0_frame.yaxis.x, tool0_frame.yaxis.y, tool0_frame.yaxis.z))
# ---------- end python_3 ----------
python_4 = PythonScript(ur10=python.ur10, q=num, tool0=pln)  # -> tool0; inputs q: list
# ---------- python_4: Python ----------
import Rhino.Geometry as rg

R0, R1, R2, R3, R4, R5 = ur10.get_forward_transformations(q)

def rhino_transform(transformation_matrix):
    T = rg.Transform(1)
    for x in range(4):
        for y in range(4):
            exec("T.M%i%i = transformation_matrix[%i][%i]" % (x,y,x,y))
    return T
robot_color = (180,180,180)

R0 = rhino_transform(R0.matrix)
R1 = rhino_transform(R1.matrix)
R2 = rhino_transform(R2.matrix)
R3 = rhino_transform(R3.matrix)
R4 = rhino_transform(R4.matrix)
R5 = rhino_transform(R5.matrix)


tool0.Transform(R5)
# ---------- end python_4 ----------
pln_2 = Plane(python_3.pl)
# inclination_length for 2, 4, 10, 15
# inclination_length for 30
# Calculate edge curves
pln_3 = Plane(python_4)

# ==== cluster UR5
use_brep = ClusterInput()

# ---- group: meshes
base_shoulder = Mesh(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)
upperarm = Mesh(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)
forearm = Mesh(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)
wrist1 = Mesh(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)
wrist2 = Mesh(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)
wrist3 = Mesh(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)

# ---- group: breps
base_shoulder_2 = Brep(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)
upperarm_2 = Brep(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)
forearm_2 = Brep(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)
wrist1_2 = Brep(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)
wrist2_2 = Brep(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)
wrist3_2 = Brep(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)

# ----
python = PythonScript()  # -> j1, j2, j3, j4, j5, j6, lines
# ---------- python: Python ----------
import Rhino.Geometry as rg
import ghpythonlib.components as ghcomp
import math

#define UR5_PARAMS
d1 =  89.159
a2 = -425.00
a3 = -392.25
d4 =  109.15
d5 =  94.65
d6 =  82.3

shoulder_offset = 135.85
elbow_offset =   -119.7


vectors = []
vectors.append(rg.Vector3d.ZAxis)
vectors.append(-rg.Vector3d.YAxis)
vectors.append(rg.Vector3d.XAxis)
vectors.append(-rg.Vector3d.YAxis)
vectors.append(rg.Vector3d.XAxis)

vectors.append(-rg.Vector3d.YAxis)
vectors.append(-rg.Vector3d.ZAxis)
vectors.append(-rg.Vector3d.YAxis)

lines = []
lines.append(rg.Line(rg.Point3d(0,0,0), vectors[0] * d1))
lines.append(rg.Line(lines[-1].To, vectors[1] * shoulder_offset))
lines.append(rg.Line(lines[-1].To, vectors[2] * a2))
lines.append(rg.Line(lines[-1].To, vectors[3] * elbow_offset))
lines.append(rg.Line(lines[-1].To, vectors[4] * a3))


lines.append(rg.Line(lines[0].To + rg.Vector3d.XAxis * (a2 + a3), vectors[5] * d4))
lines.append(rg.Line(lines[-1].To, vectors[6] * d5))
lines.append(rg.Line(lines[-1].To, vectors[7] * d6))
# ---------- end python ----------
ur5_mesh = Mesh([base_shoulder, upperarm, forearm, wrist1, wrist2, wrist3])
ur5_brep = Geometry([base_shoulder_2, upperarm_2, forearm_2, wrist1_2, wrist2_2, wrist3_2])
use_brep_2 = Boolean(use_brep)
j1 = Curve(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)
j2 = Curve(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)
j3 = Curve(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)
j4 = Curve(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)
j5 = Curve(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)
j6 = Curve(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)
filter = StreamFilter(Gate=use_brep_2, Stream0=ur5_mesh, Stream1=ur5_brep)
py = PythonScript(j1=j1)  # -> workspace
# ---------- py: Python ----------
import Rhino.Geometry as rg

workspace_center = j1.PointAtEnd
workspace_radius = 1860.50/2

WS = rg.Sphere(workspace_center, workspace_radius)

plane = rg.Plane.WorldXY
plane.Origin = workspace_center - plane.ZAxis * workspace_radius
C = rg.Cylinder(rg.Circle(plane,110), workspace_radius * 2)

workspace = rg.Brep.CreateBooleanDifference(rg.Brep.CreateFromSphere(WS), rg.Brep.CreateFromCylinder(C, True, True), 0.1)[0]
# ---------- end py ----------
ur5_axes = Curve([j1, j2, j3, j4, j5, j6])
ur5_workspace = Geometry(py)
ur5_tp = Plane(PlaneXZ(-817.25, -191.45, -5.491))
ur5_geo = Geometry(filter)
ur5_axes_2 = ClusterOutput(ur5_axes)
ur5_geo_2 = ClusterOutput(ur5_geo)
ur5_workspace_2 = ClusterOutput(ur5_workspace)
ur5_tp_2 = ClusterOutput(ur5_tp)
